# Grasshopper definition 201119_Bending_Membrane_MLAGENTS.gh (Grasshopper 1.0.7)
# plug-ins: Kangaroo Components, Weaverbird, Kangaroo2 Components, Human, Bifocals

construct_domain = ConstructDomain(DomainStart="-1", DomainEnd="1")
receive = CSharpScript()  # -> A, B, C
# ---------- receive: C# ----------
    Register(Component);

    A = num1;
    B = num2;
    C = registered;
# ---------- receive: C# additional code ----------
  double num1 = 0;
  double num2 = 0;

  bool registered = false;
  IGH_Component comp = null;

  void Register(IGH_Component component)
  {
    if(!registered)
    {
      Rhino.Runtime.HostUtils.RegisterNamedCallback("GH:GetSliders", aMethodName);

      comp = component;

      registered = true;
    }
  }

  void aMethodName(object sender, Rhino.Runtime.NamedParametersEventArgs args)
  {
    double value1;
    double value2;
    if (args.TryGetDouble("number1", out value1))
      num1 = (double) value1;

    if (args.TryGetDouble("number2", out value2))
      num2 = (double) value2;

    comp.ExpireSolution(true);
  }
# ---------- end receive ----------
panel = Panel(receive.C)
number_slider = Slider(0.63, range=0..1)
number_slider_2 = Slider(0.63, range=0..1)
remap_numbers = RemapNumbers(Source=construct_domain, Target=Domain(0, 1))  # -> Mapped, Clipped
remap_numbers_2 = RemapNumbers(Source=construct_domain, Target=Domain(0, 1))  # -> Mapped, Clipped

# ---- group: BENDING HOOP WITH CABLENET/MEMBRANE
mesh = Mesh(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)
pt = Point([Point(0, 10, 0), Point(10, 10, 0), Point(10, 0, 0), Point(0, 0, 0)])
wbnaked = WeaverbirdsNakedBoundary(MeshClosedPolylines=mesh)
warpweft = WarpWeft(Mesh=mesh)  # -> Warp, Weft, NakedA, NakedB
explode = Explode(Curve=wbnaked, Recursive=True)  # -> Segments, Vertices
not = GateNot(A=warpweft.NakedA)
not_2 = GateNot(A=warpweft.NakedB)
shift = ShiftList(List=explode.Segments, Shift=1, Wrap=True)
cull = CullPattern(List=warpweft.Warp, CullPattern=not)
cull_2 = CullPattern(List=warpweft.Weft, CullPattern=not_2)
angle = Angle(LineA=explode.Segments, LineB=shift, RestAngle=Slider(0, range=0..100), Strength=Slider(30, range=0..100))
length_line = LengthLine(Line=explode.Segments, Strength=Slider(100, range=0..100))
len = Length(Curve=cull)
anchor = Anchor(Point=pt, Strength=1000)
len_2 = Length(Curve=cull_2)
multiplication = Multiplication(A=receive.A, B=len)
multiplication_2 = Multiplication(A=receive.B, B=len_2)
length_line_2 = LengthLine(Line=cull, Length=multiplication, Strength=Slider(0.52, range=0..3))
length_line_3 = LengthLine(Line=cull_2, Length=multiplication_2, Strength=Slider(0.26, range=0..3))
solver = Solver(Reset=Button(), Threshold=1e-15, Tolerance=0.01, On=True)  # -> I, V, O

# ----
show = Show(G=mesh)
zombiesolver = ZombieSolver(
    GoalObjects=flatten([length_line, angle, length_line_2, anchor, length_line_3, show]),
    Threshold=1e-10,
    Tolerance=0.01,
    MaxIterations=50000)  # -> I, V, O
sortbytype = SortObjectsByType(RhinoObjects=zombiesolver.O)  # -> Points, Curves, Surfaces, Breps, Meshes, TextObjects, HatchObjects, LightObjects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
mesh_2 = Mesh(sortbytype.Meshes)
area = Area(Geometry=mesh_2)  # -> Area, Centroid
multiplication_3 = Multiplication(A=area.Area, B="100")
# force 2 decimal points
round = Round(Number=multiplication_3)  # -> Nearest, Floor, Ceiling
division = Division(A=round.Floor, B="100")
# normalize area values
construct_domain_2 = ConstructDomain(DomainStart="191.12", DomainEnd="384.84")
c_script = CSharpScript(meshList=mesh_2, name="Mechanism")  # inputs meshList: list of Mesh, name: String
# ---------- c_script: C# ----------
    var mesh = meshList.ToArray();

    using(var args = new Rhino.Runtime.NamedParametersEventArgs())
    {
      args.Set("mesh", mesh);
      args.Set("name", name);
      Rhino.Runtime.HostUtils.ExecuteNamedCallback("Unity:GetList", args);
    }
# ---------- end c_script ----------
remap_numbers_3 = RemapNumbers(Value=division, Source=construct_domain_2, Target=Domain(0, 1))  # -> Mapped, Clipped
panel_2 = Panel(remap_numbers_3.Mapped)
c_script_2 = CSharpScript(num=remap_numbers_3.Mapped)  # inputs num: Double
# ---------- c_script_2: C# ----------
    using(var args = new Rhino.Runtime.NamedParametersEventArgs())
    {
      args.Set("num", num);

      Rhino.Runtime.HostUtils.ExecuteNamedCallback("Unity:GetNumber", args);
    }
# ---------- end c_script_2 ----------
