# Grasshopper definition unity_communcation2.gh (Grasshopper 1.0.7)
# plug-ins: Kangaroo2 Components, Bifocals

mplane = MeshPlane(Boundary={Plane=PlaneXY(0, 0, 0), Size=Domain2(u=-10..10, v=-10..10)}, WidthCount="10", HeightCount="10")  # -> Mesh, Area
medges = MeshEdges(Mesh=mplane.Mesh)  # -> NakedEdges, InteriorEdges, NonManifoldEdges
demesh = DeconstructMesh(Mesh=mplane.Mesh)  # -> Vertices, Faces, Colours, Normals
Z = UnitZ(Factor=1)
mc = MeshCorners(Mesh=mplane.Mesh, Angle=2.35619449)
merge = Merge(Data1=medges.NakedEdges, Data2=medges.InteriorEdges)
anchor = Anchor(Point=mc, Strength=10000)
show = Show(G=mplane.Mesh)
length_line = LengthLine(Line=merge, Strength=Slider(12, range=5..50))
load = Load(Point=demesh.Vertices, ForceVector=Z, Weighting=1)
merge_2 = Merge(Data1=show, Data2=length_line, Data3=load, Data4=anchor)
button = Button()

# ---- group: Receives "Main Camera" location from Unity
receive = CSharpScript()  # -> A
# ---------- receive: C# ----------
    Register(Component);

    A = pt;
# ---------- receive: C# additional code ----------
  Point pt = null;
  bool registered = false;
  IGH_Component comp = null;

  void Register(IGH_Component component)
  {
    if(!registered)
    {
      Rhino.Runtime.HostUtils.RegisterNamedCallback("ToGrasshopper", ToGrasshopper);

      comp = component;

      registered = true;
    }
  }

  void ToGrasshopper(object sender, Rhino.Runtime.NamedParametersEventArgs args)
  {
    Rhino.Geometry.GeometryBase[] values;
    if (args.TryGetGeometry("point", out values))
      pt = values[0] as Rhino.Geometry.Point;

    comp.ExpireSolution(true);
  }
# ---------- end receive ----------

# ----
number_slider = Slider(1.17, range=0.01..3)
number_slider_2 = Slider(6.28, range=0..6.28)
Z_2 = UnitZ(Factor=1)
solver = Solver(GoalObjects=merge_2, Reset=button, Threshold=1e-15, Tolerance=0.01, On=True)  # -> I, V, O; disabled
brep = Brep([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])
bouncysolver = BouncySolver(GoalObjects=merge_2, Reset=button, Threshold=1e-15, Tolerance=0.01, Damping=0.99, Iterations=10, On=True)  # -> I, V, O
mesh = Mesh(brep)
volume = Volume(Geometry=mesh)  # -> Volume, Centroid
line = LineSDL(Start=volume.Centroid, Direction=Z_2, Length=1)
scale = Scale(Geometry=mesh, Center=volume.Centroid, Factor=number_slider)  # -> Geometry, Transform
rotate = Rotate(Geometry=scale.Geometry, Angle=number_slider_2, Plane=PlaneXY(0, 0, 0))  # -> Geometry, Transform
rotax = RotateAxis(Geometry=scale.Geometry, Angle=number_slider_2, Axis=line)  # -> Geometry, Transform
item = ListItem(List=bouncysolver.O, Index=0, Wrap=True)
mjoin = MeshJoin(Meshes=mesh)
flipm = FlipMesh(Mesh=item, VertexNormals=True, FaceNormals=True, FaceOrientation=True)
mjoin_2 = MeshJoin(Meshes=[item, flipm])
scale_2 = Scale(Geometry=mjoin, Center=Point(0, 0, 0), Factor=number_slider)  # -> Geometry, Transform

# ---- group: Receives "Main Camera" location from Unity
receive_2 = CSharpScript()  # -> A; same code as receive

# ----
receive_3 = CSharpScript()  # -> A
# ---------- receive_3: C# ----------
    Register(Component);

    A = sl;
# ---------- receive_3: C# additional code ----------
  double sl = double.NaN;

  bool registered = false;
  IGH_Component comp = null;

  void Register(IGH_Component component)
  {
    if(!registered)
    {
      Rhino.Runtime.HostUtils.RegisterNamedCallback("GH:GetNumber", aMethodName);

      comp = component;

      registered = true;
    }
  }

  void aMethodName(object sender, Rhino.Runtime.NamedParametersEventArgs args)
  {
    double values;
    if (args.TryGetDouble("number", out values))
      sl =(double)values;

    comp.ExpireSolution(true);
  }
# ---------- end receive_3 ----------
rotate_2 = Rotate(Geometry=scale_2.Geometry, Angle=number_slider_2, Plane=PlaneXY(0, 0, 0))  # -> Geometry, Transform
panel = Panel(receive_2)
# 6-Unity Slider in GH
panel_2 = Panel(receive_3)
weld = WeldMesh(Mesh=mjoin_2, Angle=3.141592654)
# 5 - ease of use
c_script = CSharpScript(meshList=weld, name="Kangaroo")  # inputs meshList: list of Mesh, name: String
# ---------- c_script: C# ----------
    var mesh = meshList.ToArray();

    using(var args = new Rhino.Runtime.NamedParametersEventArgs())
    {
      args.Set("mesh", mesh);
      args.Set("name", name);
      Rhino.Runtime.HostUtils.ExecuteNamedCallback("Unity:GetList", args);
    }
# ---------- end c_script ----------
pt = Point(Point(16.49720579, -12.70627994, 18.77725309))
c_script_2 = CSharpScript()  # inputs meshList: list of Mesh
# ---------- c_script_2: C# ----------
    var mesh = meshList.ToArray();

    using(var args = new Rhino.Runtime.NamedParametersEventArgs())
    {
      args.Set("mesh", mesh);
      Rhino.Runtime.HostUtils.ExecuteNamedCallback("Unity:GetList", args);
    }
# ---------- end c_script_2 ----------
# 5 - send list of meshes
c_script_3 = CSharpScript(meshList=rotate.Geometry, name="Head1")  # inputs meshList: list of Mesh, name: String; same code as c_script
# 1 - explain the orginal
c_script_4 = CSharpScript()  # inputs mesh: Mesh
# ---------- c_script_4: C# ----------
    using(var args = new Rhino.Runtime.NamedParametersEventArgs())
    {
      args.Set("mesh", mesh);
      Rhino.Runtime.HostUtils.ExecuteNamedCallback("Unity:FromGrasshopper", args);
    }
# ---------- end c_script_4 ----------
# 3 - send number to text panel with name
c_script_5 = CSharpScript(num=Slider(4.798, range=0..10), name="ghtxt")  # inputs num: Double, name: String
# ---------- c_script_5: C# ----------
    using(var args = new Rhino.Runtime.NamedParametersEventArgs())
    {
      args.Set("num", num);
      args.Set("name", name);
      Rhino.Runtime.HostUtils.ExecuteNamedCallback("Unity:GetNumber", args);
    }
# ---------- end c_script_5 ----------
# 2 - send string to public text
c_script_6 = CSharpScript(s="Hello World")  # inputs s: String
# ---------- c_script_6: C# ----------
    using(var args = new Rhino.Runtime.NamedParametersEventArgs())
    {
      args.Set("word", s);
      Rhino.Runtime.HostUtils.ExecuteNamedCallback("Unity:GetStr", args);
    }
# ---------- end c_script_6 ----------
# 4 - send point to control object's position
c_script_7 = CSharpScript(pt=pt, name="Cube")  # inputs pt: Point3d, name: String
# ---------- c_script_7: C# ----------
    using(var args = new Rhino.Runtime.NamedParametersEventArgs())
    {
      args.Set("point", pt);
      args.Set("name", name);
      Rhino.Runtime.HostUtils.ExecuteNamedCallback("Unity:GetPoint", args);
    }
# ---------- end c_script_7 ----------
