# Grasshopper definition unity_communcation.gh (Grasshopper 1.0.7)

brep = Brep([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])
mesh = Mesh(brep)
scale = Scale(Geometry=mesh, Center=Point(0, 0, 0), Factor=Slider(3, range=0.01..3))  # -> Geometry, Transform
mjoin = MeshJoin(Meshes=mesh)
rotate = Rotate(Geometry=scale.Geometry, Angle=Slider(1.73, range=0..6.28), Plane=PlaneXY(0, 0, 0))  # -> Geometry, Transform
lng = ListLength(List=rotate.Geometry)  # -> expr("x+1", Length)
brep_2 = Brep(<brep referenced from the Rhino model>)
series = Series(Start=0, Step=1, Count=lng)
mesh_2 = Mesh(brep_2)
concat = Concatenate(FragmentA="material", FragmentB=series)
concat_2 = Concatenate(FragmentA="name", FragmentB=series)
merge = Merge(Data1=rotate.Geometry, Data2=mesh_2)
c_script = CSharpScript(meshes=merge, names=concat_2, materials=concat)  # -> A; inputs meshes: list of Mesh, names: list of String, materials: list of String
# ---------- c_script: C# ----------
    meshes.ToArray();
    string name = names[0];
    string material = materials[0];

    for (int i = 1;i < names.Count;i++)
    {
      name += ",";
      name += names[i];
    }

    for (int i = 1;i < materials.Count;i++)
    {
      material += ",";
      material += materials[i];
    }

    using(var args = new Rhino.Runtime.NamedParametersEventArgs())
    {
      args.Set("mesh", meshes);
      args.Set("name", name);
      args.Set("material", material);
      Rhino.Runtime.HostUtils.ExecuteNamedCallback("FetchStaticMeshes", args);


    }
# ---------- end c_script ----------
